# Grasshopper definition solarcanopy.gh (Grasshopper 1.0.7)
# plug-ins: Pufferfish

segments = GetNumber(Slider(8, range=3..15), AtLeast=1, AtMost=1, Maximum=1.797693135e+308, Minimum=-1.797693135e+308)
radius1 = GetNumber(Slider(30, range=2..80), AtLeast=1, AtMost=1, Maximum=1.797693135e+308, Minimum=-1.797693135e+308)
radius2 = GetNumber(Slider(30, range=2..80), AtLeast=1, AtMost=1, Maximum=1.797693135e+308, Minimum=-1.797693135e+308)
radius3 = GetNumber(Slider(10, range=2..80), AtLeast=1, AtMost=1, Maximum=1.797693135e+308, Minimum=-1.797693135e+308)
disp1 = GetNumber(Slider(20, range=1..60), AtLeast=1, AtMost=1, Maximum=1.797693135e+308, Minimum=-1.797693135e+308)
disp2 = GetNumber(Slider(50, range=1..60), AtLeast=1, AtMost=1, Maximum=1.797693135e+308, Minimum=-1.797693135e+308)
panelascale = GetNumber(Slider(2, range=0..10), AtLeast=1, AtMost=1, Maximum=1.797693135e+308, Minimum=-1.797693135e+308)
panelaangle = GetNumber(Slider(0, range=-90..90), AtLeast=1, AtMost=1, Maximum=1.797693135e+308, Minimum=-1.797693135e+308)
panelbscale = GetNumber(Slider(1.5, range=0..10), AtLeast=1, AtMost=1, Maximum=1.797693135e+308, Minimum=-1.797693135e+308)
panelbangle = GetNumber(Slider(0, range=-90..90), AtLeast=1, AtMost=1, Maximum=1.797693135e+308, Minimum=-1.797693135e+308)
panelcscale = GetNumber(Slider(1.5, range=0..10), AtLeast=1, AtMost=1, Maximum=1.797693135e+308, Minimum=-1.797693135e+308)
panelcangle = GetNumber(Slider(0, range=-90..90), AtLeast=1, AtMost=1, Maximum=1.797693135e+308, Minimum=-1.797693135e+308)
paneldscale = GetNumber(Slider(2, range=0..10), AtLeast=1, AtMost=1, Maximum=1.797693135e+308, Minimum=-1.797693135e+308)
paneldangle = GetNumber(Slider(0, range=-90..90), AtLeast=1, AtMost=1, Maximum=1.797693135e+308, Minimum=-1.797693135e+308)
reduction = GetNumber(Slider(0, range=0..1), AtLeast=1, AtMost=1, Maximum=1.797693135e+308, Minimum=-1.797693135e+308)
pt = ConstructPoint(XCoordinate=0, YCoordinate=0, ZCoordinate=0)
Z = UnitZ(Factor=disp1)
Z_2 = UnitZ(Factor=disp2)
num = Number(disp2)
move = Move(Geometry=pt, Motion=Z_2)  # -> Geometry, Transform
move_2 = Move(Geometry=pt, Motion=Z)  # -> Geometry, Transform
panel = Panel("15")
polygon = Polygon(Plane=pt, Radius=radius1, Segments=segments, FilletRadius=0)  # -> Polygon, Length
polygon_2 = Polygon(Plane=move_2.Geometry, Radius=radius2, Segments=segments, FilletRadius=0)  # -> Polygon, Length
polygon_3 = Polygon(Plane=move.Geometry, Radius=radius3, Segments=segments, FilletRadius=0)  # -> Polygon, Length
entwine = Entwine(Branch00=polygon.Polygon, Branch01=polygon_2.Polygon, Branch02=polygon_3.Polygon, FlattenInputs=True)  # -> flatten(Result)
loft_opt = LoftOptions(Closed=False, Adjust=False, Rebuild=0, Refit=0, Type=0)
expression = Expression(x=radius2, Expression="10*x")
loft = Loft(Curves=entwine, Options=loft_opt)
qrsettings = QuadRemeshSettings(TargetCount=expression, AdaptiveSize=0, AdaptiveCount=False, HardEdges=False, SeamEdges=0, Symmetry=0, GuideCurves=0)
qrmesh = QuadRemesh(Mesh=loft, Settings=qrsettings)
demesh = DeconstructMesh(Mesh=qrmesh)  # -> Vertices, Faces, Colours, Normals
face_boundaries = FaceBoundaries(Mesh=qrmesh)
face_normals = FaceNormals(Mesh=qrmesh)  # -> Centers, Normals
number_slider = Slider(2, range=0..10)
explode = Explode(Curve=face_boundaries, Recursive=True)  # -> Segments, Vertices
line = LineSDL(Start=face_normals.Centers, Direction=face_normals.Normals, Length=expr("-x", number_slider))
line_2 = LineSDL(Start=demesh.Vertices, Direction=demesh.Normals, Length=expr("-x", number_slider))
expression_2 = Expression(x=num, Expression="x/4")
item = ListItem(List=explode.Vertices, Index=0, Wrap=True)  # -> Item, Item1, Item2, Item3
num_2 = Number(expression_2)
ln = Line(StartPoint=item.Item, EndPoint=item.Item2)
ln_2 = Line(StartPoint=item.Item1, EndPoint=item.Item3)
merge = Merge(Data1=ln, Data2=ln_2)  # -> flatten(Result)
merge_2 = Merge(Data1=line, Data2=line_2)
crv = Curve(merge_2)
end = EndPoints(Curve=crv)  # -> Start, End
pdecon = Deconstruct(Point=end.Start)  # -> XComponent, YComponent, ZComponent
expression_3 = Expression(x=num_2, Expression="x*3")
expression_4 = Expression(x=num_2, Expression="x*2")
expression_5 = Expression(x=num_2, Expression="x")
roundd = RoundToDecimalPlace(NumberX=pdecon.ZComponent, DecimalPlace="1", RoundType=0)  # -> Rounded, Difference
larger = LargerThan(FirstNumber=roundd.Rounded, SecondNumber=expression_3)  # -> LargerThan, OrEqualTo
smaller = SmallerThan(FirstNumber=roundd.Rounded, SecondNumber=expression_3)  # -> SmallerThan, OrEqualTo
larger_2 = LargerThan(FirstNumber=roundd.Rounded, SecondNumber=expression_4)  # -> LargerThan, OrEqualTo
smaller_2 = SmallerThan(FirstNumber=roundd.Rounded, SecondNumber=expression_4)  # -> SmallerThan, OrEqualTo
larger_3 = LargerThan(FirstNumber=roundd.Rounded, SecondNumber=expression_5)  # -> LargerThan, OrEqualTo
smaller_3 = SmallerThan(FirstNumber=roundd.Rounded, SecondNumber=expression_5)  # -> SmallerThan, OrEqualTo
and = GateAnd(A=smaller.SmallerThan, B=larger_2.OrEqualTo)
and_2 = GateAnd(A=smaller_2.SmallerThan, B=larger_3.OrEqualTo)
cull = CullPattern(List=crv, CullPattern=larger.OrEqualTo)
cull_2 = CullPattern(List=crv, CullPattern=and)
cull_3 = CullPattern(List=crv, CullPattern=and_2)
cull_4 = CullPattern(List=crv, CullPattern=smaller_3.SmallerThan)
crv_2 = Curve(cull)
crv_3 = Curve(cull_2)
crv_4 = Curve(cull_3)
crv_5 = Curve(cull_4)
end_2 = EndPoints(Curve=crv_2)  # -> Start, End
end_3 = EndPoints(Curve=crv_3)  # -> Start, End
end_4 = EndPoints(Curve=crv_4)  # -> Start, End
end_5 = EndPoints(Curve=crv_5)  # -> Start, End
pl = ConstructPlane(Origin=end_2.Start, XAxis=crv_2, YAxis="0,0,1")
pl_2 = ConstructPlane(Origin=end_3.Start, XAxis=crv_3, YAxis="0,0,1")
pl_3 = ConstructPlane(Origin=end_4.Start, XAxis=crv_4, YAxis="0,0,1")
pl_4 = ConstructPlane(Origin=end_5.Start, XAxis=crv_5, YAxis="0,0,1")
rotate = Rotate(Geometry=crv_2, Angle=graft(degrees(panelaangle)), Plane=pl)  # -> Geometry, Transform
rotate_2 = Rotate(Geometry=crv_3, Angle=graft(degrees(panelbangle)), Plane=pl_2)  # -> Geometry, Transform
rotate_3 = Rotate(Geometry=crv_4, Angle=graft(degrees(panelcangle)), Plane=pl_3)  # -> Geometry, Transform
rotate_4 = Rotate(Geometry=crv_5, Angle=graft(degrees(paneldangle)), Plane=pl_4)  # -> Geometry, Transform
end_6 = EndPoints(Curve=rotate.Geometry)  # -> Start, End
end_7 = EndPoints(Curve=rotate_2.Geometry)  # -> Start, End
end_8 = EndPoints(Curve=rotate_3.Geometry)  # -> Start, End
end_9 = EndPoints(Curve=rotate_4.Geometry)  # -> Start, End
pl_5 = PlaneNormal(Origin=end_6.End, ZAxis=rotate.Geometry)
pl_6 = PlaneNormal(Origin=end_7.End, ZAxis=rotate_2.Geometry)
pl_7 = PlaneNormal(Origin=end_8.End, ZAxis=rotate_3.Geometry)
pl_8 = PlaneNormal(Origin=end_9.End, ZAxis=rotate_4.Geometry)
polygon_4 = Polygon(Plane=pl_5, Radius=panelascale, Segments="19", FilletRadius=0)  # -> Polygon, Length
polygon_5 = Polygon(Plane=pl_6, Radius=panelbscale, Segments="19", FilletRadius=0)  # -> Polygon, Length
polygon_6 = Polygon(Plane=pl_7, Radius=panelcscale, Segments="19", FilletRadius=0)  # -> Polygon, Length
polygon_7 = Polygon(Plane=pl_8, Radius=paneldscale, Segments="19", FilletRadius=0)  # -> Polygon, Length
lng = ListLength(List=polygon_4.Polygon)
lng_2 = ListLength(List=polygon_5.Polygon)
lng_3 = ListLength(List=polygon_6.Polygon)
lng_4 = ListLength(List=polygon_7.Polygon)
multiplication = Multiplication(A=lng, B=reduction)
multiplication_2 = Multiplication(A=lng_2, B=reduction)
multiplication_3 = Multiplication(A=lng_3, B=reduction)
multiplication_4 = Multiplication(A=lng_4, B=reduction)
reduce = RandomReduce(List=rotate.Geometry, Reduction=multiplication, Seed=1)
reduce_2 = RandomReduce(List=polygon_4.Polygon, Reduction=multiplication, Seed=1)
reduce_3 = RandomReduce(List=rotate_2.Geometry, Reduction=multiplication_2, Seed=1)
reduce_4 = RandomReduce(List=polygon_5.Polygon, Reduction=multiplication_2, Seed=1)
reduce_5 = RandomReduce(List=rotate_3.Geometry, Reduction=multiplication_3, Seed=1)
reduce_6 = RandomReduce(List=polygon_6.Polygon, Reduction=multiplication_3, Seed=1)
reduce_7 = RandomReduce(List=rotate_4.Geometry, Reduction=multiplication_4, Seed=1)
reduce_8 = RandomReduce(List=polygon_7.Polygon, Reduction=multiplication_4, Seed=1)
crv_6 = Curve(reduce)
srf = Surface(reduce_2)
srf_2 = Surface(reduce_4)
srf_3 = Surface(reduce_8)
srf_4 = Surface(reduce_6)
crv_7 = Curve(reduce_3)
crv_8 = Curve(reduce_5)
crv_9 = Curve(reduce_7)
merge_3 = Merge(Data1=srf, Data2=srf_2, Data3=srf_4, Data4=srf_3)
merge_4 = Merge(Data1=crv_6, Data2=crv_7, Data3=crv_8, Data4=crv_9)
lng_5 = ListLength(List=merge)
pipe = Pipe(Curve=merge_4, Radius=".2", Caps="1")  # -> flatten(Pipe)
area = Area(Geometry=reduce_2)  # -> Area, Centroid
lng_6 = ListLength(List=flatten(srf))
lng_7 = ListLength(List=flatten(srf_2))
area_2 = Area(Geometry=reduce_4)  # -> Area, Centroid
lng_8 = ListLength(List=flatten(srf_4))
area_3 = Area(Geometry=srf_3)  # -> Area, Centroid
lng_9 = ListLength(List=flatten(srf))
area_4 = Area(Geometry=reduce_8)  # -> Area, Centroid
mesh = Mesh(pipe)
mesh_2 = Mesh(merge_3)
ma = MassAddition(Input=area.Area)  # -> Result, PartialResults
ma_2 = MassAddition(Input=area_2.Area)  # -> Result, PartialResults
ma_3 = MassAddition(Input=area_3.Area)  # -> Result, PartialResults
ma_4 = MassAddition(Input=area_4.Area)  # -> Result, PartialResults
offmsh = OffsetMesh(Mesh=mesh_2, Distance="0.1", BothSides=False, CreateSolid=True)  # -> flatten(Offset)
lng_10 = ListLength(List=flatten(mesh_2))
repeat = RepeatData(Data=ColourSwatch(SwatchColor=RGB(0, 255, 229)), Length=lng_5)
entwine_2 = Entwine(Branch00=mesh, Branch01=offmsh, FlattenInputs=True)
lng_11 = ListLength(List=flatten(entwine_2))
c_script = CSharpScript(crv=merge, color=repeat)  # -> out, A; inputs crv: Curve, color: Color
# ---------- c_script: C# ----------
    var c = color.R + "," + color.G + "," + color.B;
    crv.SetUserString("color", c);
    A = crv;
# ---------- end c_script ----------
bnd = Bounds(Numbers=lng_11)
remap = RemapNumbers(Value=lng_11, Source=bnd, Target=Domain(0, 1))  # -> Mapped, Clipped
gradient = Gradient(
    LowerLimit=0,
    UpperLimit=1,
    Parameter=remap.Mapped,
    stops=[0.196: RGB(255, 178, 0), 0.396: RGB(255, 0, 102), 0.596: RGB(234, 0, 255), 0.804: RGB(0, 255, 213)])
ma_5 = MassAddition(Input=[ma.Result, ma_2.Result, ma_3.Result, ma_4.Result])  # -> Result, PartialResults
c_script_2 = CSharpScript(mesh=entwine_2, color=gradient)  # -> out, A; inputs mesh: Mesh, color: Color
# ---------- c_script_2: C# ----------
    var c = color.R + "," + color.G + "," + color.B;
    mesh.SetUserString("color", c);
    A = mesh;
# ---------- end c_script_2 ----------

# ---- group: RH_OUT:PBarea
data = Data(ma_2.Result)

# ---- group: RH_OUT:PCarea
data_2 = Data(ma_3.Result)

# ---- group: RH_OUT:PAangle
data_3 = Data(panelaangle)

# ---- group: RH_OUT:PBangle
data_4 = Data(panelbangle)

# ---- group: RH_OUT:PCangle
data_5 = Data(panelcangle)

# ---- group: RH_OUT:PDangle
data_6 = Data(paneldangle)

# ---- group: RH_OUT:PAnum
data_7 = Data(lng_6)

# ---- group: RH_OUT:PAarea
data_8 = Data(ma.Result)

# ---- group: RH_OUT:PBnum
data_9 = Data(lng_7)

# ---- group: RH_OUT:PCnum
data_10 = Data(lng_8)

# ---- group: RH_OUT:PDnum
data_11 = Data(lng_9)

# ---- group: RH_OUT:PDarea
data_12 = Data(ma_4.Result)

# ---- group: RH_OUT:PTarea
data_13 = Data(ma_5.Result)

# ---- group: RH_OUT:PTnum
data_14 = Data(lng_10)

# ---- group: RH_OUT:mesh
mesh_3 = Mesh(c_script_2.A)

# ---- group: RH_OUT:line
crv_10 = Curve(c_script.A)
